test file "Horloge_interne_v3_test"
  coverage: Decision, MCDC, Condition

suite "Horloge_interne_v3/Horloge_Interne"

  case "Horloge_interne_v3_Harness" [baseline]
    model Horloge_interne_v3, harness Horloge_interne_v3_Harness (for Horloge_interne_v3/Horloge_Interne)

suite "Horloge_interne_v3/Horloge_Interne/Changes_Interval"

  case "CHANGES" [baseline]
    model Horloge_interne_v3, harness CHANGES (for Horloge_interne_v3/Horloge_Interne/Changes_Interval)

suite "Horloge_interne_v3/Horloge_Interne/Day_adjustment/CD_when_Month//Year_overflows"

  case "CD_6" [baseline]
    model Horloge_interne_v3, harness CD_6 (for Horloge_interne_v3/Horloge_Interne/Day_adjustment/CD_when_Month//Year_overflows)

suite "Horloge_interne_v3/Horloge_Interne/Day_adjustment/Subsystem2"

  case "CD_5" [baseline]
    model Horloge_interne_v3, harness CD_5 (for Horloge_interne_v3/Horloge_Interne/Day_adjustment/Subsystem2)

suite "Horloge_interne_v3/Horloge_Interne/Hour_adjustment"

  case "CHANGED_HOUR2" [baseline]
    model Horloge_interne_v3, harness CHANGED_HOUR2 (for Horloge_interne_v3/Horloge_Interne/Hour_adjustment)

suite "Horloge_interne_v3/Horloge_Interne/Last_Day_of_Month"

  case "Last_Day_Month_scenario2" [baseline]
    model Horloge_interne_v3, harness Last_Day_Month_scenario2 (for Horloge_interne_v3/Horloge_Interne/Last_Day_of_Month)

suite "Horloge_interne_v3/Horloge_Interne/Leap_Year"

  case "Leap_scenario1" [baseline]
    model Horloge_interne_v3, harness Leap_scenario1 (for Horloge_interne_v3/Horloge_Interne/Leap_Year)

suite "Horloge_interne_v3/Horloge_Interne/MATLAB Function1"

  case "CYN_remD2" [baseline]
    model Horloge_interne_v3, harness CYN_remD2 (for Horloge_interne_v3/Horloge_Interne/MATLAB Function1)

suite "Horloge_interne_v3/Horloge_Interne/MN_from_DN"

  case "AM_2" [baseline]
    model Horloge_interne_v3, harness AM_2 (for Horloge_interne_v3/Horloge_Interne/MN_from_DN)

suite "Horloge_interne_v3/Horloge_Interne/H_var_State1"

  case "DN_LDY_V1" [baseline]
    model Horloge_interne_v3, harness DN_LDY_V1 (for Horloge_interne_v3/Horloge_Interne/H_var_State1)